# Grasshopper definition assemblages.gh (Grasshopper 0.9.76)
# plug-ins: CORE.GH, Human

squelette = Curve([<curve referenced from the Rhino model> x3])
sections = Curve(<curve referenced from the Rhino model>)

crv = Curve(squelette)
sections_2 = Curve(sections)
objatts = ObjectAttributes(ObjectOrAttributes=crv)  # -> Name, LayerName, LayerFullPath, Color, MaterialName, LinetypeName, GroupIndices, PlotWeight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
tsort = SortText(Keys=objatts.LayerName, Values=crv, Culture=127)  # -> Keys, Values
dcon = DeleteConsecutive(Set=tsort.Keys, Wrap=False)  # -> simplify(flatten(Set)), Count
mindex = MemberIndex(Set=dcon.Set, Member=graft(objatts.LayerName))  # -> flatten(Index), Count

resolution = Number(Slider(10, range=0..10))
epaisseurassemblage = Number(Slider(7, range=0..10))
taille_assemblage = Number(Slider(39, range=0..100))
margeassemblage = Number(Slider(2, range=0..10))
sections_3 = Curve(simplify(flatten(sections_2)))
sectionsindex = Integer(mindex.Index)
squelette_2 = Curve(crv)
num = Number(resolution)

divide = DivideCurve(Curve=squelette_2, Count=num, Kinks=False)  # -> Points, Tangents, Parameters
item = ListItem(List=sections_3, Index=sectionsindex, Wrap=True)  # -> simplify(graft(Item))
eval = EvaluateCurve(Curve=graft(squelette_2), Parameter=divide.Parameters)  # -> simplify(Point), Tangent, Angle
area = Area(Geometry=item)  # -> Area, Centroid
pl = PlaneNormal(Origin=eval.Point, ZAxis=eval.Tangent)  # -> simplify(Plane)
pl_origin = PlaneOrigin(Base=item, Origin=area.Centroid)  # -> simplify(Plane)
num_2 = Number(margeassemblage)
orient = Orient(Geometry=item, Source=pl_origin, Target=pl)  # -> Geometry, Transform
num_3 = Number(epaisseurassemblage)
offset = Offset(Curve=orient.Geometry, Distance=num_2, Plane=pl, Corners=1)  # -> simplify(Curve)
path_mapper = PathMapper(offset, source="{A;B}(i)", target="{A}(B)")
offset_2 = Offset(Curve=path_mapper, Distance=num_3, Plane=pl, Corners=1)
path_mapper_2 = PathMapper(offset_2, source="{A;B}(i)", target="{A}(B)")
loft = Loft(Curves=orient.Geometry, Options={Adjust=True, Closed=False, LoftEnds=0, LoftSimp=0, LoftType=0, Rebuild=10, Refit=0.01})
loft_2 = Loft(Curves=path_mapper_2, Options={Adjust=True, Closed=False, LoftEnds=0, LoftSimp=0, LoftType=0, Rebuild=10, Refit=0.01})
loft_3 = Loft(Curves=path_mapper, Options={Adjust=True, Closed=False, LoftEnds=0, LoftSimp=0, LoftType=0, Rebuild=10, Refit=0.01})
cap = CapHoles(Brep=flatten(loft_2))
cap_2 = CapHoles(Brep=flatten(loft))
cap_3 = CapHoles(Brep=flatten(loft_3))

mcx = MultipleCurves(Curves=squelette_2)  # -> Points, IndexA, IndexB, ParamA, ParamB
pt = Point(flatten(mcx.Points))
cullduppoints = RemoveDuplicatePoints(InputPoints=pt, Tolerance=0.001)  # -> OutputPoints, FirstPointIndexes
null = NullItem(Item=cullduppoints.OutputPoints)  # -> NullFlags, InvalidFlags, Description
cull = CullPattern(List=cullduppoints.OutputPoints, CullPattern=invert(null.NullFlags))
ptassemblages = Point(cull)
num_4 = Number(taille_assemblage)
sph = Sphere(Base=cull, Radius=expr("x*2", num_4))  # -> simplify(graft(Sphere))
sph_2 = Sphere(Base=ptassemblages, Radius=num_4)  # -> simplify(graft(Sphere))

interieur = Brep(cap_3)
exterieur = Brep(cap)

# ---- group: Sort Items by joints
crv_cp = CurveClosestPoint(Point=graft(ptassemblages), Curve=reparameterize(squelette_2))  # -> Point, Parameter, simplify(Distance)
bool = Boolean(invert(crv_cp.Distance))
cull_2 = CullPattern(List=interieur, CullPattern=bool)  # -> simplify(List)

# ----
squelette_3 = Curve(squelette_2)
cull_3 = CullPattern(List=squelette_3, CullPattern=bool)  # -> simplify(List)
cull_4 = CullPattern(List=crv_cp.Parameter, CullPattern=bool)  # -> simplify(List)
squelette_by_joint = Curve(cull_3)
assemblage = Brep(sph_2)
interieur_2 = Brep(cull_2)

# ---- group: Find intersection point between each joint branch
data = Data(interieur_2)
data_2 = Data(graft(data))
cluster = Cluster(data=data)
bbx = BrepBrep(BrepA=cluster, BrepB=data_2)  # -> simplify(Curves), Points
path_mapper_3 = PathMapper(bbx.Curves, source="{A;B;C}", target="{A;B}")
explode = Explode(Curve=path_mapper_3, Recursive=True)  # -> Segments, simplify(Vertices)
path_mapper_4 = PathMapper(explode.Vertices, source="{A;B;C}", target="{A;B}")

# ----
tasseauassemblage = Brep(sph)
cluster_2 = Cluster(data=squelette_by_joint)
data_3 = Data(graft(squelette_by_joint))
squelette_by_joint_2 = Curve(cull_3)
lnln = LineLine(LineA=data_3, LineB=cluster_2)
angle = Angle(VectorA=data_3, VectorB=cluster_2, Plane=lnln)  # -> Angle, Reflex
panel = Panel(angle.Angle)
crv_2 = Curve(graft(squelette_by_joint_2))
panel_2 = Panel(cluster)
crv_cp_2 = CurveClosestPoint(Point=path_mapper_4, Curve=crv_2)  # -> Point, Parameter, Distance
number_slider = Slider(30, range=0..100)
number_slider_2 = Slider(1, range=0..100)
number_slider_3 = Slider(0, range=0..1)

# ---- group: Position of Joint (Start, center, end)
num_5 = Number(graft(cull_4))
equals = Equality(FirstNumber=num_5, SecondNumber=1)  # -> Equality, Inequality
larger = LargerThan(FirstNumber=num_5, SecondNumber=0)  # -> LargerThan, OrEqualTo
addition = Addition(A=equals.Equality, B=larger.LargerThan)
num_6 = Number(addition)
panel_3 = Panel(num_6)

# ----
bnd = Bounds(Numbers=crv_cp_2.Parameter)

# ---- group: Offset for encapsulating joint
num_7 = Number(0)
num_8 = Number(expr("-x", number_slider))
num_9 = Number(number_slider)
num_10 = Number([num_7, num_9])
num_11 = Number(num_7)
num_12 = Number([num_8, num_9])
weave = Weave(Pattern=num_6, Stream0=num_10, Stream1=num_12, Stream2=num_11, NullGaps=False)
num_13 = Number(weave)
panel_4 = Panel(num_13)

# ----
dedomain = DeconstructDomain(Domain=bnd)  # -> Start, End
num_14 = Number(expr("-x", number_slider_2))
num_15 = Number(number_slider_2)
num_16 = Number([dedomain.Start, dedomain.End])
num_17 = Number([num_14, number_slider_3])
num_18 = Number([num_14, num_15])
num_19 = Number([number_slider_3, num_15])
sort = SortList(Keys=num_16)  # -> Keys, ValuesA
weave_2 = Weave(Pattern=addition, Stream0=num_19, Stream1=num_18, Stream2=num_17, NullGaps=False)
panel_5 = Panel(num_16)
addition_2 = Addition(A=weave, B=sort.Keys)
cull_5 = CullPattern(List=addition_2, CullPattern=weave_2)
pframe = PerpFrame(Curve=crv_2, Parameter=num_16)
pframe_2 = PerpFrame(Curve=crv_2, Parameter=cull_5)
path_mapper_5 = PathMapper(pframe, source="{A;B}", target="{A}")
path_mapper_6 = PathMapper(pframe_2, source="{A;B}", target="{A}")
pln = Plane(path_mapper_5)
pln_2 = Plane(path_mapper_6)
panel_6 = Panel(path_mapper_6)

# ==== cluster Cluster
data = ClusterInput()
data_2 = Data(data)
lng = ListLength(List=data_2)
num = Number(expr("x-1", lng))
dup = DuplicateData(Data=data_2, Number=lng, Order=True)  # -> simplify(Data)
series = Series(Start=0, Step=1, Count=lng)  # -> simplify(Series)
multiplication = Multiplication(A=series, B=lng)
addition = Addition(A=multiplication, B=num)
num_2 = Number(graft(series))
dom = ConstructDomain(DomainStart=multiplication, DomainEnd=addition)
subset = SubList(List=dup, Domain=dom, Wrap=True)  # -> List, Index
cull_i = CullIndex(List=subset.List, Indices=num_2, Wrap=True)  # -> simplify(List)
data_3 = Data(cull_i)
data_4 = ClusterOutput(data_3)
